# Grasshopper definition Simple.ghx (Grasshopper 1.0.7)
# plug-ins: Caribou

panel = Panel("addr:street=Taranaki Street")
panel_2 = Panel("building")
panel_3 = Panel("cuisine=mexican")
panel_4 = Panel("highway=traffic_signals")
specify_features = SpecifyFeatures(
    selectionIncludesObscure=True,
    selectionSerialised="aerialway=*,aeroway=*,amenity=*,barrier=*,boundary=*,building=*,craft=*,emergency=*,geological=*,healthcare=*,highway=*,historic=*,landuse=*,leisure=*,man_made=*,military=*,natural=*,office=*,place=*,power=*,public_transport=*,railway=*,route=*,shop=*,sport=*,telecom=*,tourism=*,water=*,waterway=*")  # -> OSMFeatures, Debug

# ---- group: Melbourne CBD
path = FilePath(["Z:\Sites\Caribou\Caribou.Tests\Cases\melbourne.xml", "/Users/philip/Sites/Caribou/Caribou.Tests/Cases/melbourne.xml"])

# ---- group: Wellington CBD
path_2 = FilePath(["/Users/philip/Sites/Caribou/Caribou.Tests/Cases/wellington-overpass-export.osm", "Z:\Sites\Caribou\Caribou.Tests\Cases\wellington-overpass-export.osm"])

# ----
path_3 = FilePath(path_2)
text = Text(specify_features.OSMFeatures)
extract_ways = ExtractWays(OSMFilePath=path_3, OSMFeatures=text)  # -> Ways, Tags, Report, Debug
extract_nodes = ExtractNodes(OSMFilePath=path_3, OSMFeatures=text)  # -> Nodes, Tags, Report, Debug
report = Panel(extract_nodes.Report)

# ---- group: Visualise in Grasshopper with Per-Feature Colors
text_2 = Text(extract_ways.Report)
data = Data(extract_ways.Ways)
data_2 = Data(extract_nodes.Nodes)
rectangle = Rectangle({Plane=PlaneXY(2657819.891, 4006251.231, 0), Size=Domain2(u=-387259.1388..387259.1388, v=-1366045.973..1366045.973)})
color_per_branch = ColorPerBranch(report=text_2)  # -> colour_2, tags_2
legend = Legend(Colour=color_per_branch.colour_2, Tags=color_per_branch.tags_2, Rectangle=rectangle, LegendType=1)
custom_preview = CustomPreview(Geometry=data, Material=graft(color_per_branch.colour_2))
custom_preview_2 = CustomPreview(Geometry=data_2, Material=graft(color_per_branch.colour_2))

# ==== cluster ColorPerBranch
report = ClusterInput()
report_2 = Text(report)
list_item = ListItem(List=report_2, Index="0", Wrap=True)  # -> flatten(Item)
list_length = ListLength(List=list_item)
series = Series(Start=0, Step=1, Count=list_length)
panel = Panel(list_length)
gradient = Gradient(
    LowerLimit=0,
    UpperLimit=list_length,
    Parameter=series,
    stops=[0: RGB(243, 57, 0), 0.1: RGB(236, 27, 60), 0.2: RGB(210, 0, 118), 0.3: RGB(103, 0, 120), 0.4: RGB(39, 72, 161), 0.5: RGB(1, 192, 229), 0.6: RGB(18, 178, 90), 0.7: RGB(79, 186, 8), 0.8: RGB(220, 237, 32), 0.9: RGB(247, 159, 20), 1: RGB(243, 57, 0)])
tags = Text(list_item)
colour = Colour(gradient)
tags_2 = ClusterOutput(tags)
colour_2 = ClusterOutput(colour)
